# Grasshopper definition HilbertCurving.gh (Grasshopper 1.0.7)

merge = Merge(Data1=Slider(3.1, range=0..100), Data2=Slider(77.8, range=0..100))
merge_2 = Merge(Data1=Slider(13.5, range=0..100), Data2=Slider(89.9, range=0..100))
crv = Curve(<curve referenced from the Rhino model>)
python = GhPythonScript(x=merge_2, y=merge)  # -> out, a; inputs x: list, y: list
# ---------- python: Python ----------
import Rhino.Geometry as rg

x_int = rg.Interval(x[0], x[1])
y_int = rg.Interval(y[0], y[1])

a = rg.Rectangle3d(rg.Plane.WorldXY, x_int, y_int)
# ---------- end python ----------
python_2 = GhPythonScript(
    crvs=crv,
    GLOBAL_SCALE=Slider(0.5, range=0.5..100),
    max_depth=Slider(8, range=0..10),
    x=Slider(9.42, range=1..10),
    y=Slider(8.6, range=1..10),
    z=Slider(6.12, range=1..10),
    height=Slider(7.56, range=1..10))  # -> out, a; inputs crvs: list of Curve
# ---------- python_2: Python ----------
import os
import sys

file_name = ghenv.Component.OnPingDocument().FilePath

def get_parent(path, degree = 1):
    
    parent = path
    
    for i in range(degree):
        
        parent = os.path.dirname(parent)
        
    return parent
    
path = get_parent(file_name, 3)

sys.path.append(os.path.join(path, 'src') )

from spacemapping_curve.quadtree import *
import spacemapping_curve.distance as sdf
import spacemapping_curve.hilbertcurve as hc

import Rhino.Geometry as rg
import rhinoscriptsyntax as rs 

reload(hc)
reload(sdf)

# ==============================================================================
# get distance value
# ==============================================================================
sdf.DistanceToCurve.GLOBAL_SCALE = GLOBAL_SCALE * .01
# sdf.FuckYouBernhardFunction.GLOBAL_SCALE = GLOBAL_SCALE

# sdf.SDF.X_SCALE = x
# sdf.SDF.Y_SCALE = y
# sdf.SDF.Z_SCALE = z

# sdf.FuckYouBernhardFunction.HEIGHT = height * z

crv_distance = sdf.DistanceToCurve(crvs)

pinch_d = sdf.PinchD(x, y, z, height, GLOBAL_SCALE, 10, -.5, 14)

gyroid = sdf.Gyroid(x, y, z, height, GLOBAL_SCALE * 10.0)

structure = hc.BooleanUnion([crv_distance, pinch_d, gyroid])

# ==============================================================================
# Main
# ==============================================================================

a = hc.draw_hc(200, max_depth, structure)
# ---------- end python_2 ----------
panel = Panel(python_2.out)
